# Grasshopper definition A2_grasshopper.gh (Grasshopper 0.9.80)

md_slider = MDSlider(
    slider_value=Point(0.9756097561, 0.8902439024, 0.5),
    SliderMode=0,
    x_domain=Domain(-50, 30),
    y_domain=Domain(10, 30),
    z_domain=Domain(0, 1))
md_slider_2 = MDSlider(
    slider_value=Point(0.9390243902, 0.25, 0.5),
    SliderMode=0,
    x_domain=Domain(-2, 30),
    y_domain=Domain(-10, 30),
    z_domain=Domain(0, 1))
md_slider_3 = MDSlider(
    slider_value=Point(0.6280487805, 0.9024390244, 0.5),
    SliderMode=0,
    x_domain=Domain(-50, 30),
    y_domain=Domain(10, 30),
    z_domain=Domain(0, 1))
cir = Circle(Plane=PlaneXY(0, 0, 0), Radius=Slider(15, range=0..30))
cir_2 = Circle(Plane=md_slider_2, Radius=Slider(15, range=0..30))
cir_3 = Circle(Plane=md_slider, Radius=Slider(15, range=0..30))
cir_4 = Circle(Plane=md_slider_3, Radius=Slider(15, range=0..30))
md_slider_4 = MDSlider(
    slider_value=Point(0.5, 0.48958476, 0.5),
    SliderMode=0,
    x_domain=Domain(-30, 60),
    y_domain=Domain(-30, 60),
    z_domain=Domain(0, 1))
md_slider_5 = MDSlider(
    slider_value=Point(0.3027194884, 0.6158536585, 0.5),
    SliderMode=0,
    x_domain=Domain(-3, 50),
    y_domain=Domain(0, 50),
    z_domain=Domain(0, 1))
number_slider = Slider(3.985, range=0..10)
multiplication = Multiplication(A=number_slider, B=Slider(-0.432, range=-0.5..5))
rectangle = Rectangle(Plane=md_slider_5, XSize=number_slider, YSize=Slider(10, range=0..10), Radius=0)  # -> Rectangle, Length
vec = VectorXYZ(XComponent=multiplication, YComponent=0, ZComponent=0)  # -> Vector, Length
arrpolar = PolarArray(Geometry=rectangle.Rectangle, Plane=md_slider_4, Count=Slider(4, range=1..4), Angle=Slider(18.85, range=0..90))  # -> Geometry, Transform
move = Move(Geometry=arrpolar.Geometry, Motion=vec.Vector)  # -> Geometry, Transform
